# Grasshopper definition CircleArea.gh (Grasshopper 1.0.8)
# plug-ins: RhinoCodePluginGH

radius = Slider(100, range=50..100)
pt = Point(Point(0, 0, 0))
area = Slider(23019, range=10000..50000)
circle = CircleCNR(Center=pt, Normal=Vector(0, 0, 1), Radius=radius)
area_2 = Area(Geometry=circle)  # -> Area, Centroid
larger = LargerThan(FirstNumber=area_2.Area, SecondNumber=area)  # -> LargerThan, OrEqualTo
at = AssertTrue(larger.LargerThan)
